# Grasshopper definition calc_cplane.gh (Grasshopper 1.0.7)

# ---- group: BREP_A
# Multiple object input is not supported.
brep = Brep(<brep referenced from the Rhino model>)

# ----
debrep = DeconstructBrep(Brep=brep)  # -> Faces, Edges, Vertices
srf = Surface(debrep.Faces)
area = Area(Geometry=srf)  # -> Area, Centroid
sort = SortList(Keys=area.Area, ValuesA=srf)  # -> Keys, ValuesA
split = SplitList(List=sort.ValuesA, Index="2")  # -> ListA, ListB

# ---- group: Not Koguchi
srf_2 = Surface(split.ListB)

# ---- group: Koguchi
srf_3 = Surface(split.ListA)

# ----
planar = IsPlanar(Surface=srf_2, Interior=True)  # -> Planar, Plane
dispatch = Dispatch(List=srf_2, DispatchPattern=planar.Planar)  # -> ListA, ListB

# ---- group: Planar
srf_4 = Surface(dispatch.ListA)

# ---- group: Not Planar
srf_5 = Surface(dispatch.ListB)

# ----
partition = PartitionList(List=srf_4, Size="4")
bang = ExplodeTree(Data=partition)  # -> _0000, _0001

# ---- group: B
srf_6 = Surface(bang._0000)

# ---- group: A
srf_7 = Surface(bang._0001)

# ----
area_2 = Area(Geometry=srf_6)  # -> Area, Centroid
area_3 = Area(Geometry=srf_7)  # -> Area, Centroid
avr = Average(Input=area_2.Centroid)
avr_2 = Average(Input=area_3.Centroid)
brep_cp = BrepClosestPoint(Point=avr, Brep=srf_6)  # -> Point, Normal, Distance
brep_cp_2 = BrepClosestPoint(Point=avr_2, Brep=srf_7)  # -> Point, Normal, Distance
sort_2 = SortList(Keys=brep_cp.Distance, ValuesA=srf_6)  # -> Keys, ValuesA
sort_3 = SortList(Keys=brep_cp_2.Distance, ValuesA=srf_7)  # -> Keys, ValuesA
split_2 = SplitList(List=sort_2.ValuesA, Index="2")  # -> ListA, ListB
split_3 = SplitList(List=sort_3.ValuesA, Index="2")  # -> ListA, ListB

# ---- group: A
srf_8 = Surface(split_3.ListB)

# ---- group: B
srf_9 = Surface(split_2.ListB)

# ----
area_4 = Area(Geometry=srf_8)  # -> Area, Centroid
area_5 = Area(Geometry=srf_9)  # -> Area, Centroid
pdecon = Deconstruct(Point=area_4.Centroid)  # -> XComponent, YComponent, ZComponent
pdecon_2 = Deconstruct(Point=area_5.Centroid)  # -> XComponent, YComponent, ZComponent
sort_4 = SortList(Keys=pdecon.ZComponent, ValuesA=srf_8)  # -> Keys, ValuesA
sort_5 = SortList(Keys=pdecon_2.ZComponent, ValuesA=srf_9)  # -> Keys, ValuesA
srf_10 = Surface(sort_4.ValuesA)
srf_11 = Surface(sort_5.ValuesA)
item = ListItem(List=srf_10, Index=0, Wrap=True)
item_2 = ListItem(List=srf_11, Index=0, Wrap=True)
area_6 = Area(Geometry=srf_11)  # -> Area, Centroid
area_7 = Area(Geometry=srf_10)  # -> Area, Centroid
planar_2 = IsPlanar(Surface=item, Interior=True)  # -> Planar, Plane
planar_3 = IsPlanar(Surface=item_2, Interior=True)  # -> Planar, Plane
pt = Point(area_6.Centroid)
pt_2 = Point(area_7.Centroid)
dispatch_2 = Dispatch(List=pt, DispatchPattern=[True, False])  # -> ListA, ListB
dispatch_3 = Dispatch(List=pt_2, DispatchPattern=[True, False])  # -> ListA, ListB
rectangle = Rectangle(Plane=planar_3.Plane, XSize="-200 to 200", YSize="-200 to 200", Radius=0)  # -> Rectangle, Length
rectangle_2 = Rectangle(Plane=planar_2.Plane, XSize="-200 to 200", YSize="-200 to 200", Radius=0)  # -> Rectangle, Length
vec2pt = Vector2Pt(PointA=dispatch_2.ListA, PointB=dispatch_2.ListB, Unitize=False)  # -> Vector, Length
vec2pt_2 = Vector2Pt(PointA=dispatch_3.ListA, PointB=dispatch_3.ListB, Unitize=False)  # -> Vector, Length
boundary = BoundarySurfaces(Edges=rectangle_2.Rectangle)
boundary_2 = BoundarySurfaces(Edges=rectangle.Rectangle)
area_8 = Area(Geometry=item_2)  # -> Area, Centroid
bbx = BrepBrep(BrepA=boundary_2, BrepB=boundary)  # -> Curves, Points
pt_3 = Point(area_8.Centroid)
crv = Curve(bbx.Curves)
crv_cp = CurveClosestPoint(Point=pt_3, Curve=crv)  # -> Point, Parameter, Distance
pl = ConstructPlane(Origin=crv_cp.Point, XAxis=vec2pt.Vector, YAxis=vec2pt_2.Vector)
pln = Plane(pl)
